# Grasshopper definition ImageRecognition.gh (Grasshopper 1.0.7)

series = Series(Start=0, Step=1, Count=Slider(960, range=0..1000))
series_2 = Series(Start=0, Step=1, Count=Slider(600, range=0..1000))
crossref = CrossReference(ListA=series_2, ListB=series, CrossMode=1)  # -> ListA, ListB
pt = ConstructPoint(XCoordinate=crossref.ListA, YCoordinate=crossref.ListB, ZCoordinate=0)

image = ImageSampler(
    pt,
    FilePath="C:\Users\jaime\OneDrive\Imágenes\NASA.jpg",
    Filter="Value",
    Interpolate=False,
    Umax=600,
    Umin=1,
    Vmax=960,
    Vmin=1,
    Wrap=1)

# ----
# Enable the red group to represent the image with hexagons
number_slider = Slider(6, range=0..10)
panel = Panel(image)
# Enable the blue group to represent the image with lines
polygon = Polygon(Plane=pt, Radius=image, Segments=number_slider, FilletRadius=0)  # -> Polygon, Length
Y = UnitY(Factor=1)
area = Area(Geometry=polygon.Polygon)  # -> Area, Centroid
line = LineSDL(Start=pt, Direction=Y, Length=image)
scale = Scale(Geometry=polygon.Polygon, Center=area.Centroid, Factor=Slider(0.4, range=0..1))  # -> Geometry, Transform
